vi "Function.gvi"   [LabVIEW NXG 5.0.0]
panel controls:
  "stop": bool
  "milliSeconds per step": u32
  "Max Freq": f64
  "Min Freq": f64
  "Steps": f64
panel indicators:
  "y value": f64
  "quotient": f64
  "remainder_2": f64
  "remainder": f64
  "data": waveform<f64>[]
uses:
  NI::DAQmx::Internal::DAQmx Start Task.gvi
  NI::DAQmx::Internal::DAQmx Write (Counter Frequency 1Chan 1Samp).gvi
  NI::DAQmx::Internal::DAQmx Read (Analog 1D Wfm NChan NSamp Duration).gvi
  NI::DAQmx::Internal::DAQmx Stop Task.gvi
  NI::G Core::Error::Display Error.gvi
diagram:
  call "DAQmx Start Task.gvi"(task in="Analog Input") -> (task out=w1, error out=w2)
  call "DAQmx Start Task.gvi"(task in="Counter Output_2") -> (task out=w3, error out=w4)
  while (iteration -> i1) {
    call "Triangle_Wave.gvi"(Min Freq=$"Min Freq", Max Freq=$"Max Freq", loop iteration=i1, Steps=$Steps) -> (frequency=w5, y value=w6, quotient=w7, remainder_2=w8, remainder=w9)
    call "DAQmx Write (Counter Frequency 1Chan 1Samp).gvi"(task in=w3, error in=w4, frequency=w5, duty cycle=0.5, auto start=TRUE) -> (task out=w10, error out=w11)
    $"y value" <- w6
    $quotient <- w7
    $remainder_2 <- w8
    $remainder <- w9
    Divide(x=$"milliSeconds per step", y=1000) -> w12
    call "DAQmx Read (Analog 1D Wfm NChan NSamp Duration).gvi"(task in=w1, error in=w2, duration=w12) -> (task out=w13, error out=w14, data=w15)
    $data <- w15
    Wait(time to wait=$"milliSeconds per step")
    stop if $stop
  }
  call "DAQmx Stop Task.gvi"(task in=w10, error in=w11) -> (error out=w16)
  call "Display Error.gvi"(error in=w16)
  call "DAQmx Stop Task.gvi"(task in=w13, error in=w14)
