vi "Step_Oscillation.gvi"   [LabVIEW NXG 5.0.0]
inputs:
  "loop iteration": i32
  "Steps": f64
outputs:
  "fractional index or x": f64
  "quotient": f64
  "remainder_2": f64
  "remainder": f64
diagram:
  # Create X steps inside loop iteration between 0 and 1. This is to be used with a 1D array to oscillate at even steps between values [0] and [1]
  Quotient And Remainder(x=$"loop iteration", y=$Steps) -> (floor(x/y)=w1, x-y*floor(x/y)=w2)
  Quotient And Remainder(x=w1, y=2) -> (x-y*floor(x/y)=w3)
  case (w3) {
    frame 0, Default {
      Add(w2, 0) -> w4
    }
    frame 1 {
      Subtract(x=$Steps, y=w2) -> w4
    }
  }
  Divide(x=w4, y=$Steps) -> w5
  $"fractional index or x" <- w5
  $quotient <- w1
  $remainder_2 <- w2
  $remainder <- w3
