vi "Triangle_Wave.gvi"   [LabVIEW NXG 5.0.0]
inputs:
  "Min Freq": f64
  "Max Freq": f64
  "loop iteration": i32
  "Steps": f64
outputs:
  "frequency": f64
  "y value": f64
  "quotient": f64
  "remainder_2": f64
  "remainder": f64
diagram:
  call "Step_Oscillation.gvi"(loop iteration=$"loop iteration", Steps=$Steps) -> (fractional index or x=w1, quotient=w2, remainder_2=w3, remainder=w4)
  Build Array($"Min Freq", $"Max Freq") -> w5
  Interpolate 1D Array(array of numbers or points=w5, fractional index or x=w1) -> w6
  $frequency <- w6
  $"y value" <- w6
  $quotient <- w2
  $remainder_2 <- w3
  $remainder <- w4
