vi "Acquire.gvi"   [LabVIEW NXG 5.0.0]
# Perform the acquisition.  Replace the contents of this diagram with calls to acquisition hardware.
inputs:
  "Hardware Resources in": "Hardware Configuration.gtype", required
  "Data Notifier": Notifier<waveform<f64>[]>, required
  "Data Queue": Queue<waveform<f64>[]>, required
  "error in": error
outputs:
  "Hardware Resources out": "Hardware Configuration.gtype"
  "error out": error
types:
  "Signal Type.gtype" = enum{"Sine Wave", "Square Wave"}
  "Hardware Configuration.gtype" = cluster{"HW Refnum <Replace Me>": string, "Signal Type": "Signal Type.gtype"}
uses:
  Acquisition::Generate Simulated Data.gvi
diagram:
  # Acquire data from hardware. This VI may be called in a loop.
  # #CodeNeeded - Place calls to the appropriate hardware API to acquire data.  Some examples include:
  #
  # DAQmx Read - for acquiring single or multi-channel data from a DAQmx device.
  # [Instrument] Read - for acquiring single-point or multi-point data from your particular Instrument Driver.
  case ($"error in") {
    frame No Error {
      Property Node(instance in=$"Hardware Resources in") -> ("HW Refnum <Replace Me>"=w3, "Signal Type"=w4, instance out=w5)
      # #CodeNeeded - This is dummy data. Replace it with appropriate hardware calls.
      Property Node(instance in=w5, "HW Refnum <Replace Me>"=w3) -> (instance out=w2)
      call "Generate Simulated Data.gvi"(Signal Type=w4, error in=$"error in") -> (Graph Data=w6, error out=w1)
      # Ignore errors, in case the data notifier and data queue have already been closed by the main loop's Exit message.
      Send Notification(notification=w6, notifier=$"Data Notifier")
      Enqueue Element(element=w6, queue=$"Data Queue")
    }
    frame Error {
      w1 = $"error in"
      w2 = $"Hardware Resources in"
    }
  }
  $"Hardware Resources out" <- w2
  $"error out" <- w1
