vi "Acquisition Message Loop.gvi"   [LabVIEW NXG 5.0.0]
# Message loop for handling messages pertaining to the acquisition of data from the hardware.
inputs:
  "Message Queues": "All Message Queues.gtype", required
  "Data Notifier": Notifier<waveform<f64>[]>, required
  "Data Queue": Queue<waveform<f64>[]>, required
  "error in": error
outputs:
  "error out": error
types:
  "All Message Queues.gtype" = cluster{"UI": Queue<"Message Cluster.gtype">, "Acquisition": Queue<"Message Cluster.gtype">, "Logging": Queue<"Message Cluster.gtype">}
  "Signal Type.gtype" = enum{"Sine Wave", "Square Wave"}
  "Hardware Configuration.gtype" = cluster{"HW Refnum <Replace Me>": string, "Signal Type": "Signal Type.gtype"}
uses:
  Message Queue::Dequeue Message.gvi
  Acquisition::Initialize Hardware References.gvi
  Acquisition::Configure Hardware.gvi
  Message Queue::Enqueue Message (Single).gvi
  Acquisition::Acquire.gvi
  Acquisition::Stop Acquisition.gvi
  NI::G Core::Error::Build Error Cluster.gvi
  Acquisition::Error Handler - Acquisition Message Loop.gvi
diagram:
  case ($"error in") {
    frame No Error {
      Property Node(instance in=$"Message Queues") -> ("UI"=w2, "Acquisition"=w3)
      w4 = "Idle"  # Acquisition State
      # #CodeNeeded - Right-click the Data Cluster and select Open G Type. Add refnum types for the particular hardware (DAQ, VISA, etc.) you're using.  Then you can bundle/unbundle those refnums within each message that needs them.
      s1 = "Hardware Configuration.gtype" {all zero or empty}  # shift register
      s2 = w4  # shift register
      while {
        call "Dequeue Message.gvi"(Message Queue in=w3, error in=$"error in") -> (Message Queue out=w5, Message=w6, Message Data=w7, error out=w8)
        # s1: HW Refs
        # $"Data Notifier": Data Notifier
        # $"Data Queue": Data Queue
        # w2: UI Queue
        case (w6) ignore case {  # Message Cases
          frame "Initialize" {
            # Initialize  - Initialize is currently a no-op.  The hardware initialization takes place in the 'Start' message.
            w9 = w8
            w10 = s1
            w11 = default
            w12 = s2
          }
          frame "Start" {
            # Configure and start the acquisition.
            case (s2) {
              frame "Acquiring" {
                # The system is already acquiring. Ignore the "Start" message.
                w9 = w8
                w10 = s1
                w12 = s2
              }
              frame "Idle" {
                # If the system is idle, start the acquisition.
                w13 = "Acquiring"  # Acquisition State
                call "Initialize Hardware References.gvi"(Hardware Resources in=s1, error in=w8) -> (Hardware Resources out=w14, error out=w15)
                call "Configure Hardware.gvi"(Hardware Resources in=w14, error in=w15) -> (Hardware Resources out=w10, error out=w16)
                # Edit these VIs to configure the acquisition.
                call "Enqueue Message (Single).gvi"(Message Queue in=w5, Message="Acquire", error in=w8) -> (error out=w17)
                Merge Errors(w16, w17) -> (error out=w9)
                w12 = w13
              }
            }
            w11 = default
          }
          frame "Acquire" {
            # Acquire data from the hardware. Since this is a continuous acquisition, this message will always message itself to run again.
            case (s2) {
              frame "Idle" {
                # Ignore "Acquire" messages when the acquisition is idle.
                w9 = w8
                w10 = s1
                w12 = s2
              }
              frame "Acquiring" {
                call "Acquire.gvi"(Hardware Resources in=s1, Data Notifier=$"Data Notifier", Data Queue=$"Data Queue", error in=w8) -> (Hardware Resources out=w10, error out=w18)
                # Acquire more data while in the "Acquiring" state.
                call "Enqueue Message (Single).gvi"(Message Queue in=w5, Message="Acquire", error in=w8) -> (error out=w19)
                Merge Errors(w18, w19) -> (error out=w9)
                w12 = s2
              }
            }
            w11 = default
          }
          frame "Stop" {
            # Stop the Acquisition.
            case (s2) {
              frame "Idle" {
                # The system is already idle. Ignore the "Stop" message.
                w9 = w8
                w12 = s2
              }
              frame "Acquiring" {
                # If the system is acquiring, stop the acquisition.
                w20 = "Idle"  # Acquisition State
                call "Stop Acquisition.gvi"(Hardware Resources=s1, error in=w8) -> (error out=w21)
                call "Enqueue Message (Single).gvi"(Message Queue in=w2, Message="Acquisition Stopped", error in=w21) -> (error out=w9)
                w12 = w20
              }
            }
            w10 = s1
            w11 = default
          }
          frame "Update Settings" {
            # w22: New Settings
            Variant To Data(error in (no error)=w8, type=s1, variant=w7) -> (data=w22, error out=w23)
            # New settings are available, update the current ones stored in the shift register with the settings sent as part of the message.
            Select(s=w23, t=s1, f=w22) -> w10
            w9 = w8
            w11 = default
            w12 = s2
          }
          frame "Exit" {
            # Stop the VI
            # The UI Message Handler has told this VI to stop.
            # Release the Acquisition queue reference.
            Release Queue(error in=w8, queue=w5) -> (error out=w9)
            w10 = s1
            w11 = TRUE
            w12 = s2
          }
          frame "---Copy This Frame---" {
            # Duplicate this frame when creating new messages.  Change this comment in the duplicated frame to describe this message.
            Merge Errors(w8) -> (error out=w9)
            w10 = s1
            w11 = default
            w12 = s2
          }
          frame Default {
            w24 = "The invalid message string \"%s\" was received in the Acquisition Loop."
            Format Into String(formatString=w24, w6) -> w25
            call "Build Error Cluster.gvi"(code=1, description=w25) -> (error out=w9)
            w10 = s1
            w11 = default
            w12 = s2
          }
        }
        call "Error Handler - Acquisition Message Loop.gvi"(Message Queue in=w2, error in=w9) -> (error out=w1)
        next s1 = w10
        next s2 = w12
        stop if w11
      }
    }
    frame Error {
      w1 = $"error in"
    }
  }
  $"error out" <- w1
