vi "Configure Hardware.gvi"   [LabVIEW NXG 5.0.0]
# Configure the hardware.
inputs:
  "Hardware Resources in": "Hardware Configuration.gtype", required
  "error in": error
outputs:
  "Hardware Resources out": "Hardware Configuration.gtype"
  "error out": error
types:
  "Signal Type.gtype" = enum{"Sine Wave", "Square Wave"}
  "Hardware Configuration.gtype" = cluster{"HW Refnum <Replace Me>": string, "Signal Type": "Signal Type.gtype"}
diagram:
  Property Node(instance in=$"Hardware Resources in") -> ("HW Refnum <Replace Me>"=w1, instance out=w2)
  # Configure any settings that will not change with every loop iteration.
  Property Node(instance in=w2, "HW Refnum <Replace Me>"=w1) -> (instance out=w3)
  $"Hardware Resources out" <- w3
  # #CodeNeeded - Place calls to the appropriate hardware API to configure your acquisition.  Some examples include:
  #
  # DAQmx Timing - for changing the sample rate of a DAQmx task.
  # DAQmx Trigger - for creating a start trigger relative to a rising digital edge.
  # Configure Measurement - for setting the measurement mode for your particular Instrument Driver.
  # Configure Autozero - for setting autozeroing for your particular Instrument Driver.
  $"error out" <- $"error in"
