vi "Generate Simulated Data.gvi"   [LabVIEW NXG 5.0.0]
# Generates sample waveforms according to the signal type in the HW Config input.
inputs:
  "Signal Type": "Signal Type.gtype" = "Sine Wave"
  "error in": error
outputs:
  "Graph Data": waveform<f64>[]
  "error out": error
types:
  "Signal Type.gtype" = enum{"Sine Wave", "Square Wave"}
uses:
  NI::Analysis::Generation::Sine Waveform.gvi
  NI::Analysis::Generation::Square Waveform.gvi
diagram:
  # #CodeNeeded - This subVI generates simulated acquisition data. If you were to use this sample project with real hardware, this subVI could be removed.
  case ($"error in") {
    frame No Error {
      # Simulate acquisition rate of 10 Hz
      Wait(time to wait=100)
      case ($"Signal Type") {
        frame "Sine Wave" {
          call "Sine Waveform.gvi"(frequency=5, samples=100) -> (sine wave=w3)
          Build Array(w3) -> w2
        }
        frame "Square Wave" {
          call "Square Waveform.gvi"(frequency=5, samples=100) -> (square wave=w4)
          Build Array(w4) -> w2
        }
      }
      w1 = $"error in"
    }
    frame Error {
      w1 = $"error in"
      w2 = default
    }
  }
  $"error out" <- w1
  $"Graph Data" <- w2
