vi "Initialize Hardware References.gvi"   [LabVIEW NXG 5.0.0]
# Initialize the hardware references.
inputs:
  "Hardware Resources in": "Hardware Configuration.gtype", required
  "error in": error
outputs:
  "Hardware Resources out": "Hardware Configuration.gtype"
  "error out": error
types:
  "Signal Type.gtype" = enum{"Sine Wave", "Square Wave"}
  "Hardware Configuration.gtype" = cluster{"HW Refnum <Replace Me>": string, "Signal Type": "Signal Type.gtype"}
diagram:
  Property Node(instance in=$"Hardware Resources in") -> ("HW Refnum <Replace Me>"=w1, instance out=w2)
  # Open any hardware reference(s) or session(s) that you will need in this VI.
  Property Node(instance in=w2, "HW Refnum <Replace Me>"=w1) -> (instance out=w3)
  $"Hardware Resources out" <- w3
  # #CodeNeeded - Place calls to the appropriate API to initialize the hardware references for your acquisition.  Some examples include:
  #
  # DAQmx Task Name constant - for DAQmx tasks already configured in MAX.
  # DAQmx Create Virtual Channel - for programmatically creating a new DAQmx task.
  # [instrument] Initialize - for initializing a particular Instrument Driver.
  $"error out" <- $"error in"
