vi "Stop Acquisition.gvi"   [LabVIEW NXG 5.0.0]
# Stops the acquisition.
inputs:
  "Hardware Resources": "Hardware Configuration.gtype", required
  "error in": error
outputs:
  "error out": error
types:
  "Signal Type.gtype" = enum{"Sine Wave", "Square Wave"}
  "Hardware Configuration.gtype" = cluster{"HW Refnum <Replace Me>": string, "Signal Type": "Signal Type.gtype"}
diagram:
  # #CodeNeeded - Place calls to the appropriate hardware API to stop the acquisition.  Some examples include:
  #
  # DAQmx Clear Task - for closing the acquisition task for a DAQmx device.
  # [instrument] Close - for closing the task for your particular Instrument Driver.
  # Close and/or release any hardware references you opened in Initialize Hardware References.vi
  Property Node(instance in=$"Hardware Resources")
  Merge Errors($"error in") -> (error out=w1)
  $"error out" <- w1
