vi "Main.gvi"   [LabVIEW NXG 5.0.0]
# This Continuous Measurement sample project is based on the Queued Message Handler template.
# The Event Handling Loop generates messages based on user interface actions.
# The Message Handling Loop processes messages generated by the Event Handling Loop, or by other messages.  There are also Acquisition and Logging message handling loop subVIs, and a chart updating loop.
panel controls:
  "Stop": bool
  "Start": bool
  "Exit": bool
  "Select Signal": bool
  "Change Log Path": bool
panel indicators:
  "Status": string
  "Data": waveform<f64>[]
types:
  "Signal Type.gtype" = enum{"Sine Wave", "Square Wave"}
  "Hardware Configuration.gtype" = cluster{"HW Refnum <Replace Me>": string, "Signal Type": "Signal Type.gtype"}
  "Logging Configuration.gtype" = cluster{"Log File Base Path": path, "TDMS File Reference": TDMSFileRefnum}
  "Settings.gtype" = cluster{"Hardware Configuration": "Hardware Configuration.gtype", "Logging Configuration": "Logging Configuration.gtype"}
  "UI Data.gtype" = cluster{"Data <Replace Me>": bool}
uses:
  Message Queue::Create All Message Queues.gvi
  Acquisition::Acquisition Message Loop.gvi
  Logging::Logging Message Loop.gvi
  Message Queue::Enqueue Message (Single).gvi
  Support::Error Handler - Event Handling Loop.gvi
  Message Queue::Dequeue Message.gvi
  Settings::Load Settings from INI.gvi
  NI::G Core::File IO (General)::Get System Directory.gvi
  NI::G Core::Error::Display Error.gvi
  Settings::Save Settings to INI.gvi
  NI::G Core::Error::Build Error Cluster.gvi
  Support::Error Handler - Message Handling Loop.gvi
diagram:
  w1 = bool FALSE  # Stop Event
  Create User Event[EventName="Stop Event"](user event data type=w1) -> (error out=w2, user event out=w3)
  Obtain Notifier(element data type=waveform<f64>[] []) -> (notifier out=w4)
  Obtain Queue(element data type=waveform<f64>[] []) -> (queue out=w5)
  call "Create All Message Queues.gvi"(error in=w2) -> (Message Queues out=w6, error out=w7)
  call "Acquisition Message Loop.gvi"(Message Queues=w6, Data Notifier=w4, Data Queue=w5) -> (error out=w8)
  call "Logging Message Loop.gvi"(Message Queues=w6, Data Queue=w5, error in (no error)=w7) -> (error out=w9)
  # This sample project was built from the Queued Message Handler project template.
  Register For Events("Stop Event"=w3) -> (event registration refnum out=w10)
  Property Node(instance in=w6) -> ("Acquisition"=w11, "Logging"=w12, "UI"=w13)
  s1 = w10  # shift register
  while {
    event (dynamic events = s1) {
      on "Start" Value changed {
        call "Enqueue Message (Single).gvi"(Message Queue in=w13, Message="Start") -> (Message Queue out=w16, error out=w15)
        w14 = default
      }
      on "Stop" Value changed {
        call "Enqueue Message (Single).gvi"(Message Queue in=w13, Message="Stop") -> (Message Queue out=w16, error out=w15)
        w14 = default
      }
      on "Exit" Value changed {
        # The UI Message Loop handles sending the Exit message to other loops.
        call "Enqueue Message (Single).gvi"(Priority Message?=TRUE, Message Queue in=w13, Message="Exit") -> (Message Queue out=w16, error out=w15)
        w14 = default
      }
      on dynamic event 0 {
        # The Message Handling Loop processed an "Exit" message, which fired this event to stop the Event Handling Loop.
        $Status <- "Exit"
        w14 = TRUE
        w15 = default
        w16 = w13
      }
      on "Select Signal" Value changed {
        call "Enqueue Message (Single).gvi"(Message Queue in=w13, Message="Select Signal") -> (Message Queue out=w16, error out=w15)
        w14 = default
      }
      on "Change Log Path" Value changed {
        call "Enqueue Message (Single).gvi"(Message Queue in=w13, Message="Change Log Path") -> (Message Queue out=w16, error out=w15)
        w14 = default
      }
      on "Window" Close? {
        call "Enqueue Message (Single).gvi"(Priority Message?=TRUE, Message Queue in=w13, Message="Exit") -> (Message Queue out=w16)
        Event Filter("Discard?"=TRUE)
        w14 = default
        w15 = default
      }
    }
    call "Error Handler - Event Handling Loop.gvi"(Message Queue in=w16, error in=w15) -> (error out=w17)
    stop if w14
  }
  Unregister For Events(error in=w17, event registration refnum=s1) -> (error out=w18)
  w19 = "Idle"  # UI State
  s2 = "Settings.gtype" {all zero or empty}  # shift register
  s3 = "UI Data.gtype" {all zero or empty}  # shift register
  s4 = w19  # shift register
  while {
    call "Dequeue Message.gvi"(Message Queue in=w13, error in=w7) -> (Message Queue out=w20, Message=w21, Message Data=w22, error out=w23)
    # s2: Config
    # s3: UI Data
    # s4: UI State
    # w3: Stop Event
    case (w21) ignore case {  # Message Cases
      frame "Initialize" {
        # Initialize - Get configuration settings, then message the UI to initialize, and broadcast the settings to the other message loops.
        call "Load Settings from INI.gvi"(Settings in=s2) -> (Settings out=w26)
        Property Node(instance in=reference to "Select Signal", "Disabled"=FALSE)
        w29 = "Idle"  # UI State
        Property Node(instance in=reference to "Start", "Disabled"=FALSE)
        Property Node(instance in=reference to "Change Log Path", "Disabled"=FALSE)
        Property Node(instance in=reference to "Exit", "Disabled"=FALSE)
        # Enable all panel buttons.
        Property Node(instance in=reference to "Stop", "Disabled"=FALSE)
        call "Enqueue Message (Single).gvi"(Message Queue in=w20, Message="Broadcast Settings", error in=w23) -> (Message Queue out=w30, error out=w31)
        call "Enqueue Message (Single).gvi"(Message Queue in=w30, Message="Update Status", Message Data="Ready...", error in=w31) -> (error out=w24)
        w25 = default
        w27 = s3
        w28 = w29
      }
      frame "Update Status" {
        # Update Status - Convert the message data to a string to display in the Status indicator.
        Variant To Data(error in (no error)=w23, type=string "", variant=w22) -> (data=w32, error out=w24)
        $Status <- w32
        w25 = default
        w26 = s2
        w27 = s3
        w28 = s4
      }
      frame "Start" {
        # Start - Enable/Disable buttons appropriately for an acquisition that has started, and update status display.
        Property Node(instance in=reference to "Select Signal", "Disabled"=TRUE)
        w33 = "Acquiring and Logging"  # UI State
        Property Node(instance in=reference to "Start", "Disabled"=TRUE)
        Property Node(instance in=reference to "Change Log Path", "Disabled"=TRUE)
        Property Node(instance in=reference to "Exit", "Disabled"=TRUE)
        # Disable or enable panel buttons.
        Property Node(instance in=reference to "Stop", "Disabled"=FALSE)
        # Message Acquisition and Logging loops to start.
        call "Enqueue Message (Single).gvi"(Message Queue in=w20, Message="Update Status", Message Data="Acquiring and Logging...", error in=w23) -> (error out=w34)
        call "Enqueue Message (Single).gvi"(Message Queue in=w12, Message="Start", error in=w34) -> (error out=w35)
        call "Enqueue Message (Single).gvi"(Message Queue in=w11, Message="Start", error in=w35) -> (error out=w24)
        w25 = default
        w26 = s2
        w27 = s3
        w28 = w33
      }
      frame "Stop" {
        # Stop - Enable/Disable buttons appropriately for an acquisition that has stopped, and update status display.
        # Message Acquisition and Logging loops to stop
        case (s4) {
          frame "Waiting for Exit" {
            w28 = s4
          }
          frame Default {
            w36 = "Waiting for Stop"  # UI State
            w28 = w36
          }
        }
        Property Node(instance in=reference to "Select Signal", "Disabled"=FALSE)
        Property Node(instance in=reference to "Start", "Disabled"=FALSE)
        Property Node(instance in=reference to "Change Log Path", "Disabled"=FALSE)
        Property Node(instance in=reference to "Exit", "Disabled"=FALSE)
        # Disable or enable panel buttons.
        Property Node(instance in=reference to "Stop", "Disabled"=TRUE)
        call "Enqueue Message (Single).gvi"(Message Queue in=w12, Message="Stop", error in=w23) -> (error out=w37)
        call "Enqueue Message (Single).gvi"(Message Queue in=w11, Message="Stop", error in=w37) -> (error out=w24)
        w25 = default
        w26 = s2
        w27 = s3
      }
      frame "Select Signal" {
        w38 = "Square Wave"  # Signal Type
        # Launch a dialog when the user clicks the 'Select Signal' button.
        w39 = "Sine Wave"  # Signal Type
        Two Button Dialog(F button name ("Cancel")="Square Wave", T button name ("OK")="Sine Wave", message="Select Signal Type:") -> (T Button?=w40)
        Select(s=w40, t=w39, f=w38) -> w41
        Property Node(instance in=s2, "Hardware Configuration:Signal Type"=w41) -> (instance out=w26)
        call "Enqueue Message (Single).gvi"(Message Queue in=w20, Message="Broadcast Settings", error in=w23) -> (error out=w24)
        w25 = default
        w27 = s3
        w28 = s4
      }
      frame "Change Log Path" {
        call "Get System Directory.gvi"(type="Default Data Directory") -> (system directory=w42)
        File Dialog[FileDialogSelectionMode=File, NewOrExistingMode=NewOrExisting](pattern (all files)="*.tdms", pattern label="TDMS File", start path=w42) -> (cancelled=w43, error out=w44, selected path=w45)
        # Launch a dialog when the user clicks the 'Change Log Path' button.
        case (w43) {
          frame True {
            w26 = s2
            w24 = w23
          }
          frame False {
            Property Node(instance in=s2, "Logging Configuration:Log File Base Path"=w45) -> (instance out=w26)
            call "Enqueue Message (Single).gvi"(Message Queue in=w20, Message="Broadcast Settings", error in=w23) -> (error out=w24)
          }
        }
        w25 = default
        w27 = s3
        w28 = s4
      }
      frame "Acquisition Stopped" {
        # Logic for determining what action to take when the acquisition has stopped.
        case (s4) {
          frame Default {
            w28 = s4
            w24 = w23
          }
          frame "Waiting for Exit", "Waiting for Exit (Acq Stopped)" {
            w46 = "Waiting for Exit (Acq Stopped)"  # UI State
            w28 = w46
            w24 = w23
          }
          frame "Waiting for Stop", "Waiting for Stop (Acq Stopped)" {
            w47 = "Waiting for Stop (Acq Stopped)"  # UI State
            w28 = w47
            w24 = w23
          }
          frame "Waiting for Exit (Log Stopped)" {
            # If we are waiting to exit, and the logging has already stopped, then the "Acquisition Stopped" message indicates that it is time to exit.
            call "Enqueue Message (Single).gvi"(Priority Message?=TRUE, Message Queue in=w20, Message="Exit", error in=w23) -> (error out=w24)
            w28 = "Idle"
          }
          frame "Waiting for Stop (Log Stopped)" {
            w48 = "Idle"  # UI State
            # If we are waiting to stop, and the logging has already stopped, then the "Acquisition Stopped" message indicates that it is time to stop.
            call "Enqueue Message (Single).gvi"(Message Queue in=w20, Message="Update Status", Message Data="Ready...", error in=w23) -> (error out=w24)
            w28 = w48
          }
        }
        w25 = default
        w26 = s2
        w27 = s3
      }
      frame "Logging Stopped" {
        # Logic for determining what action to take when the logging has stopped.
        case (s4) {
          frame Default {
            w28 = s4
            w24 = w23
          }
          frame "Waiting for Exit", "Waiting for Exit (Log Stopped)" {
            w28 = "Waiting for Exit (Log Stopped)"
            w24 = w23
          }
          frame "Waiting for Stop", "Waiting for Stop (Log Stopped)" {
            w28 = "Waiting for Stop (Log Stopped)"
            w24 = w23
          }
          frame "Waiting for Exit (Acq Stopped)" {
            # If we are waiting to exit, and the acquisition has already stopped, then the "Logging Stopped" message indicates that it is time to exit.
            call "Enqueue Message (Single).gvi"(Priority Message?=TRUE, Message Queue in=w20, Message="Exit", error in=w23) -> (error out=w24)
            w28 = "Idle"
          }
          frame "Waiting for Stop (Acq Stopped)" {
            # If we are waiting to stop, and the acquisition has already stopped, then the "Logging Stopped" message indicates that it is time to stop.
            call "Enqueue Message (Single).gvi"(Message Queue in=w20, Message="Update Status", Message Data="Ready...", error in=w23) -> (error out=w24)
            w28 = "Idle"
          }
        }
        w25 = default
        w26 = s2
        w27 = s3
      }
      frame "Broadcast Settings" {
        Property Node(instance in=s2) -> ("Hardware Configuration"=w49, "Logging Configuration"=w50)
        # Broadcast settings - Send the 'Update Settings' message to the Logging and Acquisition message loops.
        call "Enqueue Message (Single).gvi"(Message Queue in=w11, Message="Update Settings", Message Data=w49) -> (error out=w51)
        call "Enqueue Message (Single).gvi"(Message Queue in=w12, Message="Update Settings", Message Data=w50, error in=w51) -> (error out=w52)
        Merge Errors(w52, w23) -> (error out=w24)
        w25 = default
        w26 = s2
        w27 = s3
        w28 = s4
      }
      frame "Error" {
        # Error - Display an error dialog. This message is sent by the "Error Handler" VIs at the end of other loops in this application.
        Variant To Data(error in (no error)=w23, type=no error, variant=w22) -> (data=w53, error out=w24)
        call "Display Error.gvi"(error in=w53)
        w25 = default
        w26 = s2
        w27 = s3
        w28 = s4
      }
      frame "Exit" {
        # Exit - Send Exit messages to the Acquisition and Logging loops, and fire the user event to stop the Event Handling Loop.
        Property Node(instance in=reference to "Select Signal", "Disabled"=FALSE)
        Property Node(instance in=reference to "Start", "Disabled"=FALSE)
        # Enable all panel buttons.
        Property Node(instance in=reference to "Change Log Path", "Disabled"=FALSE)
        Property Node(instance in=reference to "Exit", "Disabled"=FALSE)
        Property Node(instance in=reference to "Stop", "Disabled"=FALSE)
        call "Enqueue Message (Single).gvi"(Priority Message?=TRUE, Message Queue in=w11, Message="Exit", error in=w23) -> (error out=w54)
        call "Enqueue Message (Single).gvi"(Priority Message?=TRUE, Message Queue in=w12, Message="Exit", error in=w54) -> (error out=w55)
        Generate User Event(error in=w55, event data=TRUE, user event=w3) -> (error out=w56)
        call "Save Settings to INI.gvi"(Settings=s2, error in=w56) -> (error out=w24)
        w25 = TRUE
        w26 = "Settings.gtype" {all zero or empty}
        w27 = s3
        w28 = "Idle"
      }
      frame "---Copy This Frame---" {
        # Duplicate this frame when creating new messages. Change this comment in the duplicated frame to describe this message.
        Merge Errors(w23) -> (error out=w24)
        w25 = default
        w26 = s2
        w27 = s3
        w28 = s4
      }
      frame Default {
        # 'Default' case only runs if there is a message that isn't defined in any of the other cases.  Output a programming error.
        w57 = "The invalid message string \"%s\" was received in the Message Handling Loop."
        Format Into String(formatString=w57, w21) -> w58
        call "Build Error Cluster.gvi"(code=1, description=w58) -> (error out=w24)
        w25 = default
        w26 = s2
        w27 = s3
        w28 = s4
      }
    }
    call "Error Handler - Message Handling Loop.gvi"(Message Queue in=w20, error in=w24) -> (error out=w59)
    next s2 = w26
    next s3 = w27
    next s4 = w28
    stop if w25
  }
  Release Queue(error in=w59, queue=w13) -> (error out=w60)
  Release Queue(error in=w60, queue=w5) -> (error out=w61)
  Release Notifier(error in (no error)=w61, notifier=w4) -> (error out=w62)
  Merge Errors(w18, w62, w8, w9) -> (error out=w63)
  Destroy User Event(error in=w63, user event=w3)
  # The notifier contains acquired data for updating the chart. When the Exit message is processed above, the notifier refnum will be released, which will stop this loop.
  # A notifier contains the acquired data that is displayed. A queue contains the acquired data that is logged.  Since a notifier is a potentially lossy communication mechanism, it is ok to use for data display, but not for logging.
  while {
    Wait On Notification(notifier=w4) -> (error out=w64, notification=w65)
    $Data <- w65
    stop if w64
  }
