vi "Error Handler - Logging Message Loop.gvi"   [LabVIEW NXG 5.0.0]
# Process an error that occurred in the Logging Message Loop, either by ignoring it, or generating an "Error" message.
inputs:
  "Message Queue in": Queue<"Message Cluster.gtype">, required
  "Ignore Errors (Runtime)": i32[]
  "error in": error
outputs:
  "Message Queue out": Queue<"Message Cluster.gtype">
  "error out": error
types:
  "Message Cluster.gtype" = cluster{"Message": string, "Message Data": variant}
uses:
  Support::Check Loop Error.gvi
diagram:
  # Error Handler for the Logging Message Loop
  $"Message Queue out" <- $"Message Queue in"
  $"error out" <- $"error in"
  # The Ignore Errors (Static List) array constant should contain ignore errors that are defined at edit time. The Ignore Errors (Runtime) array can be dynamically generated at runtime.
  w1 = i32[] []  # Ignore Errors (Static List)
  Build Array(w1, $"Ignore Errors (Runtime)") -> w2
  # #CodeRecommended - Add errors to the array as follows:
  #
  # Ignore Errors - Do nothing. Discard the error completely.
  #
  # All other errors are treated as regular errors and are sent as "Error" messages to the Message Handling Loop for further processing.
  call "Check Loop Error.gvi"(Message Queue in=$"Message Queue in", error to process=$"error in", Ignore Errors=w2)
