vi "Flush Data to Log File.gvi"   [LabVIEW NXG 5.0.0]
# Flush the data queue of any pending data and write it to the log file. Close the TDMS file reference.
inputs:
  "Logging Configuration": "Logging Configuration.gtype", required
  "Data Queue": Queue<waveform<f64>[]>, required
  "error in": error
outputs:
  "error out": error
types:
  "Logging Configuration.gtype" = cluster{"Log File Base Path": path, "TDMS File Reference": TDMSFileRefnum}
diagram:
  # Flush the data queue of any pending data and write it to the log file. Close the TDMS file reference.
  case ($"error in") {
    frame No Error {
      Property Node(instance in=$"Logging Configuration") -> ("TDMS File Reference"=w2)
      Flush Queue(queue=$"Data Queue") -> (error out=w3, remaining elements=w4)
      s1 = w2  # shift register
      s2 = $"error in"  # shift register
      for (after w3) {
        w5 = each element of w4
        Property Node(instance in=w5) -> ("Element 0"=w6)
        TDMS Write(data=w6, error in=s2, tdms file=s1) -> (error out=w7, tdms file out=w8)
        next s1 = w8
        next s2 = w7
      }
      TDMS Close(error in=s2, tdms file=s1) -> (error out=w1)
    }
    frame Error {
      w1 = $"error in"
    }
  }
  $"error out" <- w1
