vi "Log Data.gvi"   [LabVIEW NXG 5.0.0]
# This VI uses the TDMS Write function to write data to a TDMS file.
inputs:
  "Logging Configuration": "Logging Configuration.gtype", required
  "Data Queue": Queue<waveform<f64>[]>, required
  "error in": error
outputs:
  "error out": error
types:
  "Logging Configuration.gtype" = cluster{"Log File Base Path": path, "TDMS File Reference": TDMSFileRefnum}
diagram:
  Property Node(instance in=$"Logging Configuration") -> ("TDMS File Reference"=w1)
  # #CodeRecommended - This sample project uses the TDMS Write function to write data to a TDMS file. Other potential logging mechanisms include:
  #
  # Export Waveforms to Spreadsheet File - To log data in a CSV file format.
  # Write Delimited Spreadsheet - Requires parsing the waveform data and converting it into an array of numeric or string values.
  Dequeue Element(error in=$"error in", queue=$"Data Queue") -> (element=w2, error out=w3)
  TDMS Write(data=w2, error in=w3, tdms file=w1) -> (error out=w4)
  $"error out" <- w4
