vi "Logging Message Loop.gvi"   [LabVIEW NXG 5.0.0]
# The message loop subVI to handle messages pertaining to logging data.
inputs:
  "Message Queues": "All Message Queues.gtype", required
  "Data Queue": Queue<waveform<f64>[]>, required
  "error in (no error)": error
outputs:
  "error out": error
types:
  "All Message Queues.gtype" = cluster{"UI": Queue<"Message Cluster.gtype">, "Acquisition": Queue<"Message Cluster.gtype">, "Logging": Queue<"Message Cluster.gtype">}
  "Logging Configuration.gtype" = cluster{"Log File Base Path": path, "TDMS File Reference": TDMSFileRefnum}
uses:
  Message Queue::Dequeue Message.gvi
  NI::G Core::File IO (General)::Get File Extension.gvi
  Message Queue::Enqueue Message (Single).gvi
  Logging::Log Data.gvi
  Logging::Flush Data to Log File.gvi
  NI::G Core::Error::Clear Error Cluster.gvi
  NI::G Core::Error::Build Error Cluster.gvi
  Logging::Error Handler - Logging Message Loop.gvi
diagram:
  case ($"error in (no error)") {
    frame No Error {
      Property Node(instance in=$"Message Queues") -> ("UI"=w2, "Logging"=w3)
      w4 = "Idle"  # Logging State
      # #CodeRecommended - To add more sophisticated data logging to this application, right-click the Logging Configuration cluster and select Open G Type, and add path and/or file refnum information that the Logging Loop will use to save or stream data to disk.
      s1 = "Logging Configuration.gtype" {all zero or empty}  # shift register
      s2 = w4  # shift register
      while {
        call "Dequeue Message.gvi"(Message Queue in=w3, error in=$"error in (no error)") -> (Message Queue out=w5, Message=w6, Message Data=w7, error out=w8)
        # w2: UI Queue
        case (w6) ignore case {  # Message Cases
          frame "Initialize" {
            # Called when first launched. Currently a no-op.
            w9 = w8
            w10 = s1
            w11 = default
            w12 = s2
          }
          frame "Start" {
            case (s2) {
              frame "Logging" {
                # The system is already logging. Ignore the 'Start' message.
                w9 = w8
                w10 = s1
                w12 = s2
              }
              frame "Idle" {
                Property Node(instance in=s1) -> ("Log File Base Path"=w13, instance out=w14)
                # If the system is idle, start logging.
                Strip Path(path=w13) -> (stripped path=w15)
                call "Get File Extension.gvi"(file=w13) -> (filename without extension=w16, unmodified file extension=w17)
                Format Date Time String(time format string (%c)="%Y_%m_%d_%H_%M_%S") -> (date/time string=w18)
                Format Into String(formatString="_%s.%s", initString=w16, w18, w17) -> w19
                Build Path(base path=w15, name or relative path=w19) -> (appended path=w20)
                TDMS Open(error in=w8, file path=w20, operation="create or replace") -> (error out=w21, tdms file out=w22)
                Property Node(instance in=w14, "TDMS File Reference"=w22) -> (instance out=w10)
                w23 = "Logging"  # Logging State
                call "Enqueue Message (Single).gvi"(Message Queue in=w5, Message="Log", error in=w8) -> (error out=w24)
                Merge Errors(w21, w24) -> (error out=w9)
                w12 = w23
              }
            }
            w11 = default
          }
          frame "Log" {
            # Log data to disk. Since this is a continuous acquisition, this message will always message itself to run again.
            case (s2) {
              frame "Idle" {
                # Ignore "Log" messages when the logging is idle.
                w9 = w8
                w12 = s2
              }
              frame "Logging" {
                call "Log Data.gvi"(Logging Configuration=s1, Data Queue=$"Data Queue", error in=w8) -> (error out=w25)
                call "Enqueue Message (Single).gvi"(Message Queue in=w5, Message="Log", error in=w8) -> (error out=w26)
                # Log more data while in the "Logging" state.
                Merge Errors(w25, w26) -> (error out=w9)
                w12 = s2
              }
            }
            w10 = s1
            w11 = default
          }
          frame "Stop" {
            Property Node(instance in=s1, "TDMS File Reference"=TDMSFileRefnum constant) -> (instance out=w10)
            # Flush the message queue of any pending "Log" messages. Call 'Flush Data to Log File.gvi' so any pending data is not lost.
            case (s2) {
              frame "Idle" {
                # The system is already idle. Ignore the "Stop" message.
                w9 = w8
                w12 = s2
              }
              frame "Logging" {
                # If the system is logging, stop logging.
                w27 = "Idle"  # Logging State
                call "Flush Data to Log File.gvi"(Logging Configuration=s1, Data Queue=$"Data Queue", error in=w8) -> (error out=w28)
                call "Enqueue Message (Single).gvi"(Message Queue in=w2, Message="Logging Stopped", error in=w28) -> (error out=w9)
                w12 = w27
              }
            }
            w11 = default
          }
          frame "Update Settings" {
            # w29: New Settings
            # New settings are available, update the current ones stored in the shift register with the settings sent as part of the message.
            Variant To Data(error in (no error)=w8, type=s1, variant=w7) -> (data=w29, error out=w30)
            # s1: Old Settings
            # w10: Settings
            Select(s=w30, t=s1, f=w29) -> w10
            w9 = w8
            w11 = default
            w12 = s2
          }
          frame "Exit" {
            # Stop the VI
            # Call 'Flush Data to Log File' so any pending data is not lost.
            # Release the Logging queue reference
            Release Queue(error in=w8, queue=w5) -> (error out=w9)
            call "Flush Data to Log File.gvi"(Logging Configuration=s1, Data Queue=$"Data Queue", error in=w9) -> (error out=w31)
            # Don't check the error out. The file reference may have already been released.
            call "Clear Error Cluster.gvi"(error in=w31)
            w10 = s1
            w11 = TRUE
            w12 = s2
          }
          frame "---Copy This Frame---" {
            # Duplicate this frame when creating new messages.  Change this comment in the duplicated frame to describe this message.
            Merge Errors(w8) -> (error out=w9)
            w10 = s1
            w11 = default
            w12 = s2
          }
          frame Default {
            # 'Default' case only runs if there is a message that isn't defined in any of the other cases.  Output a programming error.
            w32 = "The invalid message string \"%s\" was received in the Logging Loop."
            Format Into String(formatString=w32, w6) -> w33
            call "Build Error Cluster.gvi"(code=1, description=w33) -> (error out=w9)
            w10 = s1
            w11 = default
            w12 = s2
          }
        }
        call "Error Handler - Logging Message Loop.gvi"(Message Queue in=w2, error in=w9) -> (error out=w1)
        next s1 = w10
        next s2 = w12
        stop if w11
      }
    }
    frame Error {
      w1 = $"error in (no error)"
    }
  }
  $"error out" <- w1
