vi "Create All Message Queues.gvi"   [LabVIEW NXG 5.0.0]
# This VI creates and initializes all the message queues for your application. If your application requires more than one message queue, right-click the "Message Queues" constant above and select Open Type Def.  Add the new Message Queue(s) to the type definition, then initialize them in this VI.
inputs:
  "error in": error
outputs:
  "Message Queues out": "All Message Queues.gtype"
  "error out": error
types:
  "All Message Queues.gtype" = cluster{"UI": Queue<"Message Cluster.gtype">, "Acquisition": Queue<"Message Cluster.gtype">, "Logging": Queue<"Message Cluster.gtype">}
uses:
  Message Queue::Obtain Message Queue.gvi
  Message Queue::Enqueue Message (Single).gvi
diagram:
  call "Obtain Message Queue.gvi"(error in=$"error in") -> (Message Queue=w1, error out=w2)
  call "Enqueue Message (Single).gvi"(Message Queue in=w1, Message="Initialize", error in=w2) -> (Message Queue out=w3, error out=w4)
  call "Obtain Message Queue.gvi"(error in=$"error in") -> (Message Queue=w5, error out=w6)
  call "Enqueue Message (Single).gvi"(Message Queue in=w5, Message="Initialize", error in=w6) -> (Message Queue out=w7, error out=w8)
  # This VI creates and initializes all the message queues for your application. If your application requires more than one message queue, right-click the "Message Queues" constant above and select Open G Type.  Add the new Message Queue(s) to the G Type, then initialize them in this VI.
  call "Obtain Message Queue.gvi"(error in=$"error in") -> (Message Queue=w9, error out=w10)
  call "Enqueue Message (Single).gvi"(Message Queue in=w9, Message="Initialize", error in=w10) -> (Message Queue out=w11, error out=w12)
  Property Node(instance in="All Message Queues.gtype" {all zero or empty}, "UI"=w3, "Acquisition"=w7, "Logging"=w11) -> (instance out=w13)
  $"Message Queues out" <- w13
  Merge Errors(w4, w8, w12) -> (error out=w14)
  $"error out" <- w14
