vi "Dequeue Message.gvi"   [LabVIEW NXG 5.0.0]
# This VI pulls messages off the Message Queue.
inputs:
  "Message Queue in": Queue<"Message Cluster.gtype">
  "error in": error
outputs:
  "Message Queue out": Queue<"Message Cluster.gtype">
  "Message": string
  "Message Data": variant
  "error out": error
types:
  "Message Cluster.gtype" = cluster{"Message": string, "Message Data": variant}
diagram:
  $"Message Queue out" <- $"Message Queue in"
  Dequeue Element(queue=$"Message Queue in") -> (element=w1, error out=w2)
  Property Node(instance in=w1) -> ("Message"=w3, "Message Data"=w4)
  $Message <- w3
  $"Message Data" <- w4
  # This VI pulls messages off the Message Queue.  It will dequeue messages regardless of incoming error.
  Merge Errors($"error in", w2) -> (error out=w5)
  $"error out" <- w5
