vi "Enqueue Message (Array).gvi"   [LabVIEW NXG 5.0.0]
# For a regular message, enqueue the message. For a priority message, enqueue it at the front of the queue.
inputs:
  "Message Queue in": Queue<"Message Cluster.gtype">
  "Message Array": string[], required
  "Message Data Array": variant[]
  "error in": error
  "Priority Message? Array": bool[]
outputs:
  "Message Queue out": Queue<"Message Cluster.gtype">
  "error out": error
types:
  "Message Cluster.gtype" = cluster{"Message": string, "Message Data": variant}
diagram:
  $"Message Queue out" <- $"Message Queue in"
  # This VI takes an array of messages, message data, and priority message settings, and enqueues those messages. The For Loop auto-indexes on the Message Array only. This allows a user to optionally wire the Message Data Array and Priority Message? Array values.
  s1 = $"error in"  # shift register
  for (iteration -> i1) {
    w1 = each element of $"Message Array"
    Array Index(array=$"Priority Message? Array") -> (out0[i1]=w2)
    Array Index(array=$"Message Data Array") -> (out0[i1]=w3)
    Property Node(instance in="Message Cluster.gtype" {all zero or empty}, "Message"=w1, "Message Data"=w3) -> (instance out=w4)
    # For a regular message, enqueue the message.  For a priority message, enqueue it at the front of the queue.
    case (w2) {
      frame False, Default {
        Enqueue Element(element=w4, error in=s1, queue=$"Message Queue in") -> (error out=w5)
      }
      frame True {
        Enqueue Element At Opposite End(element=w4, error in=s1, queue=$"Message Queue in") -> (error out=w5)
      }
    }
    next s1 = w5
  }
  $"error out" <- s1
