vi "Enqueue Message (Single).gvi"   [LabVIEW NXG 5.0.0]
# For a regular message, enqueue the message. For a priority message, enqueue it at the front of the queue.
inputs:
  "Message Queue in": Queue<"Message Cluster.gtype">
  "Message": string, required
  "Message Data": variant
  "error in": error
  "Priority Message?": bool
outputs:
  "Message Queue out": Queue<"Message Cluster.gtype">
  "error out": error
types:
  "Message Cluster.gtype" = cluster{"Message": string, "Message Data": variant}
diagram:
  $"Message Queue out" <- $"Message Queue in"
  Property Node(instance in="Message Cluster.gtype" {all zero or empty}, "Message"=$Message, "Message Data"=$"Message Data") -> (instance out=w1)
  # For a regular message, enqueue the message.  For a priority message, enqueue it at the front of the queue.
  case ($"Priority Message?") {
    frame False, Default {
      Enqueue Element(element=w1, error in=$"error in", queue=$"Message Queue in") -> (error out=w2)
    }
    frame True {
      Enqueue Element At Opposite End(element=w1, error in=$"error in", queue=$"Message Queue in") -> (error out=w2)
    }
  }
  $"error out" <- w2
