vi "Get Configuration File Path.gvi"   [LabVIEW NXG 5.0.0]
# Get the path to the Settings XML file. This is done using the Application Directory function. For more information on how Application Directory calculates its path, right-click the function and choose Help.
outputs:
  "INI File Path": path
diagram:
  # Get the path to the Settings INI file. This is done using the Get Component Directory node.
  Get Component Directory() -> (Path=w1)
  Build Path(base path=w1, name or relative path=path "Settings.ini") -> (appended path=w2)
  $"INI File Path" <- w2
