vi "Load Settings from INI.gvi"   [LabVIEW NXG 5.0.0]
# Attempts to load previous user specified settings from an INI file.
# This VI will not generate an error. If a suitable INI file can't be loaded and parsed then it will simply return the default settings.
inputs:
  "Settings in": "Settings.gtype", required
  "error in": error
outputs:
  "Settings out": "Settings.gtype"
  "error out": error
types:
  "Signal Type.gtype" = enum{"Sine Wave", "Square Wave"}
  "Hardware Configuration.gtype" = cluster{"HW Refnum <Replace Me>": string, "Signal Type": "Signal Type.gtype"}
  "Logging Configuration.gtype" = cluster{"Log File Base Path": path, "TDMS File Reference": TDMSFileRefnum}
  "Settings.gtype" = cluster{"Hardware Configuration": "Hardware Configuration.gtype", "Logging Configuration": "Logging Configuration.gtype"}
uses:
  Settings::Get Configuration File Path.gvi
  NI::G Core::Configuration File (INI)::Open Config Data.gvi
  NI::G Core::Configuration File (INI)::Read Key::Read Key (Path).gvi
  NI::G Core::File IO (General)::Check if File or Folder Exists.gvi
  NI::G Core::File IO (General)::Get System Directory.gvi
  Settings::Save Settings to INI.gvi
  NI::G Core::Configuration File (INI)::Close Config Data.gvi
diagram:
  # This VI will not generate an error.  If a suitable file cannot be loaded and parsed then it will simply return the default settings.
  case ($"error in") {
    frame No Error {
      call "Get Configuration File Path.gvi"() -> (INI File Path=w3)
      call "Open Config Data.gvi"(configuration file=w3, error in=$"error in") -> (reference=w4, error out=w5)
      call "Read Key (Path).gvi"(reference in=w4, key="Log File Base Path", error in=w5, section="Logging Configuration") -> (reference out=w6, found=w7, value=w8, error out=w9)
      call "Check if File or Folder Exists.gvi"(file or folder=w8, error in=$"error in") -> (file or folder exists?=w10, error out=w1)
      Logical And(w10, w7) -> w11
      call "Get System Directory.gvi"(type="Default Data Directory") -> (system directory=w12)
      call "Check if File or Folder Exists.gvi"(file or folder=w12) -> (file or folder exists?=w13)
      # #CodeRecommended - Specify a default logging location that will be used if a configuration file is not found.
      case (w13) {
        frame False, Default {
          # Create LabVIEW Data folder if it does not exist.
          Create Folder(path (use dialog)=w12) -> (created path=w14)
        }
        frame True {
          w14 = w12
        }
      }
      Build Path(base path=w14, name or relative path=path "Logged Data.tdms") -> (appended path=w15)
      Select(s=w11, t=w8, f=w15) -> w16
      # If there is an error trying to read the configuration file, create a new configuration file.
      Property Node(instance in=$"Settings in", "Logging Configuration:Log File Base Path"=w16) -> (instance out=w2)
      case (w11) {
        frame True { }
        frame False {
          call "Save Settings to INI.gvi"(Settings=w2)
        }
      }
      call "Close Config Data.gvi"(reference=w6, error in=w9)
    }
    frame Error {
      w1 = $"error in"
      w2 = $"Settings in"
    }
  }
  $"Settings out" <- w2
  $"error out" <- w1
