vi "Save Settings to INI.gvi"   [LabVIEW NXG 5.0.0]
# Saves the "User Specified" configuration data to an INI file. This is used to remember the users settings between executions.
inputs:
  "Settings": "Settings.gtype", required
  "error in": error
outputs:
  "error out": error
types:
  "Signal Type.gtype" = enum{"Sine Wave", "Square Wave"}
  "Hardware Configuration.gtype" = cluster{"HW Refnum <Replace Me>": string, "Signal Type": "Signal Type.gtype"}
  "Logging Configuration.gtype" = cluster{"Log File Base Path": path, "TDMS File Reference": TDMSFileRefnum}
  "Settings.gtype" = cluster{"Hardware Configuration": "Hardware Configuration.gtype", "Logging Configuration": "Logging Configuration.gtype"}
uses:
  Settings::Get Configuration File Path.gvi
  NI::G Core::Configuration File (INI)::Open Config Data.gvi
  NI::G Core::Configuration File (INI)::Write Key::Write Key (Double).gvi
  NI::G Core::Configuration File (INI)::Write Key::Write Key (Path).gvi
  NI::G Core::Configuration File (INI)::Close Config Data.gvi
diagram:
  # Saves the user-specified configuration data to an INI file. This is used to remember settings between executions.
  Property Node(instance in=$Settings) -> ("Hardware Configuration"=w1, "Logging Configuration"=w2)
  Property Node(instance in=w2) -> ("Log File Base Path"=w3)
  Property Node(instance in=w1) -> ("Signal Type"=w4)
  call "Get Configuration File Path.gvi"() -> (INI File Path=w5)
  call "Open Config Data.gvi"(configuration file=w5, error in=$"error in") -> (reference=w6, error out=w7)
  call "Write Key (Double).gvi"(reference in=w6, key="Signal Type <Replace Me>", value=w4, error in=w7, section="Hardware Configuration") -> (reference out=w8, error out=w9)
  call "Write Key (Path).gvi"(reference in=w8, key="Log File Base Path", value=w3, error in=w9, section="Logging Configuration") -> (reference out=w10, error out=w11)
  call "Close Config Data.gvi"(reference=w10, error in=w11) -> (error out=w12)
  $"error out" <- w12
