vi "Check Loop Error.gvi"   [LabVIEW NXG 5.0.0]
# Check the 'error to process' to see if its code value matches any of the values in the 'Ignore Errors' array. If so, do nothing. If not, send an "Error" message containing the error data to the Message Handling Loop for further processing. If the "Exit on Error?" input is TRUE, send an "Exit" message to the Message Handling Loop instead.
inputs:
  "Message Queue in": Queue<"Message Cluster.gtype">
  "error to process": error, required
  "Ignore Errors": i32[]
  "Exit on Error?": bool
outputs:
  "Message Queue out": Queue<"Message Cluster.gtype">
  "Error?": bool
types:
  "Message Cluster.gtype" = cluster{"Message": string, "Message Data": variant}
uses:
  NI::G Core::Error::Read Error Code.gvi
  Message Queue::Enqueue Message (Single).gvi
diagram:
  $"Message Queue out" <- $"Message Queue in"
  case ($"error to process") {
    frame Error {
      call "Read Error Code.gvi"(error in=$"error to process") -> (code=w2)
      Search 1D Array(1D array=$"Ignore Errors", element=w2) -> (index of element=w3)
      case (w3) {  # Is error in the Ignore Errors list?
        frame -1 {
          # #CodeRecommended - If you ever change the name of your "Error" or "Exit" message, you'll need to update the name of the message here.
          # This error is not in the Ignore Errors list, so send it as data along with an "Error" message, or an "Exit" message if Exit on Error? is TRUE.
          Select(s=$"Exit on Error?", t="Exit", f="Error") -> w4
          # Send 'Exit' as priority message
          call "Enqueue Message (Single).gvi"(Priority Message?=$"Exit on Error?", Message Queue in=$"Message Queue in", Message=w4, Message Data=$"error to process")
          w1 = TRUE
        }
        frame Default {
          # This error is is in the Ignore Errors list, so do not send it for processing.
          w1 = FALSE
        }
      }
    }
    frame No Error {
      # No error
      w1 = FALSE
    }
  }
  $"Error?" <- w1
