vi "Error Handler - Message Handling Loop.gvi"   [LabVIEW NXG 5.0.0]
# Process an error that occurred in the Message Handling Loop, either by ignoring it, or generating an "Exit" message.
inputs:
  "Message Queue in": Queue<"Message Cluster.gtype">
  "Ignore Errors (Runtime)": i32[] = [0]
  "error in": error
outputs:
  "Message Queue out": Queue<"Message Cluster.gtype">
  "error out": error
types:
  "Message Cluster.gtype" = cluster{"Message": string, "Message Data": variant}
uses:
  Support::Check Loop Error.gvi
diagram:
  # Error Handler for the Message Handling Loop
  $"Message Queue out" <- $"Message Queue in"
  $"error out" <- $"error in"
  # #CodeRecommended - Add errors to the array as follows:
  #
  # Ignore Errors (Static List) - Do nothing. Discard the error completely.
  # The Ignore Errors (Static List) array constant should contain ignore errors that are defined at edit time. The Ignore Errors (Runtime) array can be dynamically generated at runtime.
  w1 = i32[] []  # Ignore Errors (Static List)
  Build Array(w1, $"Ignore Errors (Runtime)") -> w2
  # #CodeRecommended - Errors that occur in the Message Handling Loop might place the application in an unknown state, and will cause the application to exit. In general, any error generated by the Message Handling Loop that can be handled without shutting down the QMH should be handled in the message itself because the QMH is not necessarily in a good state to process other messages. If you post an error message that does not exit, that should generally be for logging purposes only. Exceptions to this rule are for experienced programmers and should be reviewed with team members to check for race conditions.
  call "Check Loop Error.gvi"(Exit on Error?=TRUE, Message Queue in=$"Message Queue in", error to process=$"error in", Ignore Errors=w2)
